# Dynamo graph 05_Write-CA-Legend.dyn (Dynamo 2.16.2.5624)

python_script = Python()  # CPython3
# ---------- python_script.python (17 lines) ----------
import clr
clr.AddReference("RevitAPI")
clr.AddReference("RevitServices")
from Autodesk.Revit.DB import *
from RevitServices.Persistence import DocumentManager

# Get the active document
doc = DocumentManager.Instance.CurrentDBDocument

# Get all views
collector = FilteredElementCollector(doc).OfClass(View)

# Filter only Legend Views
legend_views = [view for view in collector if view.ViewType == ViewType.Legend]

# Output the list of legend views
OUT = legend_views
# ----------------------------------------
watch = Watch(python_script)
code_block = CodeBlock { "DSP Comp Ref"; }
python_script_2 = Python(IN[0]=code_block)  # CPython3
# ---------- python_script_2.python (43 lines) ----------
import clr
clr.AddReference("RevitAPI")
clr.AddReference("RevitServices")
from Autodesk.Revit.DB import *
from RevitServices.Persistence import DocumentManager

# Inputs
doc = DocumentManager.Instance.CurrentDBDocument

# Debugging step: check if input exists and its type
if len(IN) < 1:
    OUT = "Error: Input list is empty. Please provide an input string for the legend name."
    raise SystemExit

# Attempt to retrieve the legend name, and handle if it fails
try:
    legend_name = IN[0]
    # Debugging: print input type and content to see what is being received
    OUT = f"Input received: Type = {type(legend_name)}, Content = {legend_name}"
except IndexError:
    OUT = "Error: Unable to read input from IN[0]. Please verify the input connection."
    raise SystemExit

# Ensure the input is of the correct type (str)
if not isinstance(legend_name, str):
    OUT = f"Error: Input must be a string, received type {type(legend_name)}. Please use a string node."
    raise SystemExit

# Get all views in the document
collector = FilteredElementCollector(doc).OfClass(View)

# Filter only Legend Views with the specified name
specific_legend = None
for view in collector:
    if view.ViewType == ViewType.Legend and view.Name.strip() == legend_name.strip():
        specific_legend = view
        break

# Check if the legend was found and output the result
if specific_legend is None:
    OUT = f"Legend with name '{legend_name}' not found."
else:
    OUT = specific_legend
# ----------------------------------------
watch_2 = Watch(python_script_2)
python_script_3 = Python(IN[0]=python_script_2)  # CPython3
# ---------- python_script_3.python (31 lines) ----------
import clr
clr.AddReference("RevitAPI")
clr.AddReference("RevitServices")
from Autodesk.Revit.DB import *
from RevitServices.Persistence import DocumentManager

# Inputs
doc = DocumentManager.Instance.CurrentDBDocument
legend_view = UnwrapElement(IN[0])  # Legend View input

# Collect all elements in the Legend View
collector = FilteredElementCollector(doc, legend_view.Id).WhereElementIsNotElementType()
elements_in_legend = []

for elem in collector:
    # Get element details depending on type
    element_data = {
        "ElementId": elem.Id.IntegerValue,
        "ElementType": type(elem).__name__,
    }
    
    # Add specific information for Text Notes
    if isinstance(elem, TextNote):
        element_data["Text"] = elem.Text
        element_data["Location"] = elem.Coord  # Coord represents the XYZ location of the Text Note

    # Add other useful metadata here as needed
    elements_in_legend.append(element_data)

# Output list of dictionaries containing legend element details
OUT = elements_in_legend
# ----------------------------------------
watch_3 = Watch(python_script_3)

# group: Current Project
current = Document.Current()
filePath = Document.FilePath(document=current)

# group: Return the Folder of the Current Project
code_block_2 = CodeBlock { "\\"; }
code_block_3 = CodeBlock { "\\"; }
split = String.Split(string=filePath, separator0=code_block_3)
code_block_4 = CodeBlock { -1; }
dropItems = List.DropItems(list=split, amount=code_block_4)
join = String.Join(separator=code_block_2, string0=dropItems)

# group: Master Check Template Location
file_path = Filename("Templates\02_Master-Check.xlsx")
file_from_path = FileObject(path=file_path)
string_from_object = FromObject(object=file_from_path)

# group: Return the File Name of the Master Check Template
code_block_5 = CodeBlock { "\\"; }
code_block_6 = CodeBlock { "\\"; }
split_2 = String.Split(string=string_from_object, separator0=code_block_6)
lastItem = List.LastItem(list=split_2)
join_2 = String.Join(separator=code_block_5, string0=lastItem)

# group: Combine Into the Current Project Path and Template Name for Master Check
code_block_7 = CodeBlock { "\\"; }
combinePath = FileSystem.CombinePath(string0=join, string1=join_2)
join_3 = String.Join(separator=code_block_7, string0=combinePath)

# group: Read from Takeoff Excel
file_from_path_2 = FileObject(path=join_3)
string = StringInput("RevitExtraction")
boolean = BoolSelector(true)
importExcel = Data.ImportExcel(file=file_from_path_2, sheetName=string, showExcel=boolean)

watch_4 = Watch(importExcel)
code_block_8 = CodeBlock { "PRODUCE"; }
code_block_9 = CodeBlock { "DELI"; }
python_script_4 = Python(IN[0]=python_script_2, IN[1]=code_block_8, IN[2]=code_block_9)  # CPython3
# ---------- python_script_4.python (52 lines) ----------
import clr
clr.AddReference("RevitAPI")
clr.AddReference("RevitServices")
from Autodesk.Revit.DB import *
from RevitServices.Persistence import DocumentManager

# Inputs
doc = DocumentManager.Instance.CurrentDBDocument
legend_view = UnwrapElement(IN[0])  # Legend View input
start_marker = IN[1]  # Text marker to start extraction (e.g., "PRODUCE")
end_marker = IN[2]  # Text marker to stop extraction (e.g., "DELI")

# Collect all elements in the Legend View
collector = FilteredElementCollector(doc, legend_view.Id).WhereElementIsNotElementType()
elements_in_legend = []

for elem in collector:
    # Get element details depending on type
    element_data = {
        "ElementId": elem.Id.IntegerValue,
        "ElementType": type(elem).__name__,
    }
    
    # Add specific information for Text Notes
    if isinstance(elem, TextNote):
        element_data["Text"] = elem.Text
        element_data["Location"] = elem.Coord  # Coord represents the XYZ location of the Text Note

    elements_in_legend.append(element_data)

# Find the indices of the start and end markers
start_index = -1
end_index = -1

for i, element in enumerate(elements_in_legend):
    if element["ElementType"] == "TextNote":
        if "Text" in element:
            text = element["Text"].strip().upper()
            if text == start_marker.upper():
                start_index = i
            elif text == end_marker.upper() and start_index != -1:
                end_index = i
                break

# Extract elements between the start and end markers
elements_between_markers = []

if start_index != -1 and end_index != -1:
    elements_between_markers = elements_in_legend[start_index + 1:end_index]

# Output the elements between markers
OUT = elements_between_markers
# ----------------------------------------
watch_5 = Watch(python_script_4)
code_block_10 = CodeBlock { "DAIRY"; }
python_script_5 = Python(IN[0]=python_script_2, IN[1]=code_block_9, IN[2]=code_block_10)  # CPython3; same code as python_script_4
watch_6 = Watch(python_script_5)
